# Grasshopper definition mesh_to_obj_tool.gh (Grasshopper 1.0.7)
# plug-ins: Counter

# ----
# 1. OUTPUT GEOMETRY LIST
# 
# - Input = grouped meshes
# - Output = joined mesh list
python = GhPythonScript()  # -> out, buildings
# ---------- python: Python ----------
__author__ = "michaelhasey"

import rhinoscriptsyntax as rs
import os
import Rhino
import Rhino.Geometry as rg
import scriptcontext

doc = Rhino.RhinoDoc.ActiveDoc

def getAllJoinedBuildingMeshes():
    
    # LIST -  Master list of buildings (joined meshes)
    groups = []
    
    # cycle through building groups
    for i in range(doc.Groups.Count):
        # LIST - Meshes per building
        group_meshes = []
        
        # cycle through building group meshes
        for mesh in doc.Groups.GroupMembers(i):
            
            # convert to grasshopper geometry
            mesh = mesh.Geometry
            
            # add all building meshes together
            group_meshes.append(mesh)
        
        # Join Building Meshes 
        joinedMesh = Rhino.Geometry.Mesh()
        for indv_mesh in group_meshes:
            joinedMesh.Append(indv_mesh)            
            
        # add completed building mesh to final list
        groups.append(joinedMesh)
    
    return groups



buildings = getAllJoinedBuildingMeshes() # building_meshes
# ---------- end python ----------
mesh = Mesh(python.buildings)

cnt = Counter(Pause=<missing>, Reset=<missing>, X=<missing>)  # -> Count, S

trigger = Trigger(Interval=10, TimerInterval=10, Target=counter)  # disabled
# 7. RUN SCRIPT
# 
# Follow instructions below to run.
# 
#  1. Set Toggle to “False”
# 2. Hitt “Button” to reset timer
# 3. change last text bubble to current tile name
# 4. Hit Play button
# 5. Set toggle to “True”
toggle = BooleanToggle(True)

increment = Slider(1, range=-2..3)
# 3. START TIMER
# 
# - Input = “0” start time
# - Output = “0”, “1”, “2”… max = length of building list
start = Slider(0, range=0..100000)
counter = ImprovedDataRec(x=start, enable=toggle, reset=Button(), increment=increment)  # -> x; inputs x: Int32, enable: Boolean, reset: Boolean, increment: Int32
# ---------- counter: Python ----------
from Grasshopper import DataTree
if reset or 'rec' not in globals(): rec = x
if enable: rec = rec + increment  
x = rec
print x
# ---------- end counter ----------
panel = Panel(counter)

panel_2 = Panel(counter)

lng = ListLength(List=mesh)
# 4. STOP TIMER
# - Input = length of building list
# - Output = “False” (to stop timer)
int = Integer(panel)
timeroff = GhPythonScript(c=int, s=lng, m=Toggle(False))  # inputs s: Int32, m: Boolean
# ---------- timeroff: Python ----------
from ghpythonlib.componentbase import executingcomponent as component
import Grasshopper, GhPython
import Grasshopper as gh
import System
import Rhino
import rhinoscriptsyntax as rs

class counterOff(component):
    
    def RunScript(self, c, s, m):
        """kill the all timer in canvas if a number 'c' meets 's'.
            Inputs:
                c: counter: Current number
                s: A number for stopper
                m: Mode of stopper, if m is True, it will stop when a > s. Otherwise, it will stop when a >= s
            Outputs:"""
            
        __author__ = "leeuack"
        __version__ = "2018.04.16"
        
        import rhinoscriptsyntax as rs
        import Grasshopper as gh
        
        def timerOff():
            '''kill the all timer on canvas'''
            for object in ghenv.Component.OnPingDocument().Objects:
                if object.Name == 'Timer':
                    object_id = object.InstanceGuid
            for object in ghenv.Component.OnPingDocument().Objects:
                if type(object) == gh.Kernel.Special.GH_Timer:
                    object.Locked = True
        
        if m ==True:
            if c > s:
                timerOff()
        else: 
            if c >= s:
                timerOff()
        
        # return outputs if you have them; here I try it for you:
        return
# ---------- end timeroff ----------

item = ListItem(List=mesh, Index=int, Wrap=True)
# 2. PREPARE INDIVIDUAL BUILDINGS
# 
# - Input = joined mesh list
# - Output = Geometry in standard position
bbox = BoundingBox(Content=item, Plane=PlaneXY(0, 0, 0), UnionBox=True)  # -> Box, Box_2
area = Area(Geometry=bbox.Box)  # -> Area, Centroid
pt_target = Point(Point(0, 0, 0))
vec2pt = Vector2Pt(PointA=area.Centroid, PointB=pt_target, Unitize=False)  # -> Vector, Length
move = Move(Geometry=item, Motion=vec2pt.Vector)  # -> Geometry, Transform

folder_data_to_be_saved = FilePath("/data/2_preprocessing_files/1_obj_grasshopper_export/")
# 5. SET FILE NAME / PATH
# - Input = Building Index
# - Output = file name & path
namefile = GhPythonScript(ind=int, dir=folder_data_to_be_saved, tile_code="O02")  # -> file_name, file_path
# ---------- namefile: Python ----------
__author__ = "leeuack"
__version__ = "2021.06.08"

import rhinoscriptsyntax as rs
import os

# file_name
tile = str(tile_code)
file_name = "_montreal_{:06d}.obj".format(ind)
file_name = tile + file_name

# file_path
tile_folder = str(tile_code)
file_path = dir
# ---------- end namefile ----------
panel_3 = Panel(namefile.file_name)
panel_4 = Panel(namefile.file_path)

# ----
# 6. EXPORT BUILDINGS
# - Input = Mesh, file name & path
# - Output = .obj file
objexport = CSharpScript(in_run=int, in_mesh=move.Geometry, in_name=panel_3, in_path=panel_4)  # -> out, A; inputs in_run: Boolean, in_mesh: list of Mesh, in_name: String, in_path: String
# ---------- objexport: C# usings ----------
using System.IO;
using System.Linq;
using System.Data;
using System.Drawing;
using System.Reflection;
using System.Windows.Forms;
using System.Xml;
using System.Xml.Linq;
using System.Runtime.InteropServices;

using Rhino.DocObjects;
using Rhino.Collections;
using GH_IO;
using GH_IO.Serialization;
# ---------- objexport: C# ----------
    if(in_run) {
      path = System.IO.Path.GetDirectoryName(in_path) + "//" + in_name;
      int faceCount = 0;
      using(StreamWriter writer = new StreamWriter(path)) {
        for(int n = 0; n < in_mesh.Count; n++) {
          List<String> vert = new List<String>();
          List<String> face = new List<String>();

          in_mesh[n].Faces.ConvertQuadsToTriangles();
          BoundingBox bbox = in_mesh[n].GetBoundingBox(true);

          for(int i = 0; i < in_mesh[n].Vertices.Count; i++) {
            vert.Add(String.Format("v {0} {1} {2}", -in_mesh[n].Vertices[i].X, in_mesh[n].Vertices[i].Z, in_mesh[n].Vertices[i].Y));
          }

          for(int i = 0; i < in_mesh[n].TextureCoordinates.Count; i++) {
            double tx = in_mesh[n].TextureCoordinates[i].X;
            double ty = in_mesh[n].TextureCoordinates[i].Y;
            vert.Add(String.Format("vt " + tx.ToString("F6") + " " + ty.ToString("F6")));
          }

          for(int i = 0; i < in_mesh[n].Normals.Count; i++) {
            vert.Add(String.Format("vn {0} {1} {2}", -in_mesh[n].Normals[i].X, in_mesh[n].Normals[i].Z, in_mesh[n].Normals[i].Y));
          }

          for(int i = 0; i < in_mesh[n].Faces.Count; i++) {
            MeshFace f = in_mesh[n].Faces.GetFace(i);
            int fa = f.A + 1 + faceCount;
            int fb = f.B + 1 + faceCount;
            int fc = f.C + 1 + faceCount;
            string fas = fa.ToString();
            string fbs = fb.ToString();
            string fcs = fc.ToString();
            face.Add(String.Format("f " + fas + "/" + fas + "/" + fas + " " + fbs + "/" + fbs + "/" + fbs + " " + fcs + "/" + fcs + "/" + fcs));
          }

          for(int i = 0; i < vert.Count; i++) {
            writer.WriteLine(vert[i]);
          }

          writer.WriteLine("");
          writer.WriteLine("g " + in_name + n.ToString());

          for(int i = 0; i < face.Count; i++) {
            writer.WriteLine(face[i]);
          }
          faceCount += in_mesh[n].Vertices.Count;
        }
      }
    }
    A = path;
# ---------- objexport: C# additional code ----------
  String path;
# ---------- end objexport ----------
